# Grasshopper definition PlugInParasite.gh (Grasshopper 1.0.8)
# plug-ins: Cordyceps

cordyceps = Cordyceps(HttpPort=26929, DebugLevel=0)  # -> About, Status, LastCommand
panel_z = Slider(175, range=50..230)
mast_h = Slider(220, range=100..400)
socket_h = Slider(15, range=5..30)
spar_len = Slider(90, range=30..200)
spar_angle = Slider(36.5, range=0..75)
spar_dia = Slider(1.43, range=0.2..2)
ring_count = Slider(6, range=1..12)
rope_dia = Slider(0.22, range=0.05..1)
panel_l = Slider(54, range=10..120)
panel_w = Slider(50, range=10..120)
panel_t = Slider(0.86, range=0.2..5)
fold = Slider(1, range=0..1)
hub_z = Slider(20, range=20..150)

# ---- group: PIP_PHASE MATH
# PHASE MATH
# fold -> f_telescope, f_rise, f_open, HOOK_Z, SEG_L
fold_phases = Script(fold=fold, mast_h=mast_h)  # -> out, f_telescope, f_canopy, f_rise, f_open, f_seg2, f_seg3, HOOK_Z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
# ---------- fold_phases: Python ----------
#! python 3
# fold_phases — derives all phase fractions + telescope geometry constants
# from the master fold slider. Pure scalar math, no Rhino geometry.
# Phase chain: fold → telescope (0..0.5) → canopy (0.5..1)
#   canopy splits into rise (0.5..0.75) then open (0.75..1)
#   telescope splits into seg2 (0..0.25) then seg3 (0.25..0.5)

f = max(0.0, min(1.0, float(fold)))

# Mast cross-section + segment length constants
SEG1_R = 5.0
SEG1_L = 50.0
SEG_OVERLAP = 8.0

# Telescope/canopy phase fractions
f_telescope = max(0.0, min(1.0, f * 2.0))
f_canopy    = max(0.0, min(1.0, (f - 0.5) * 2.0))
f_rise      = max(0.0, min(1.0, f_canopy * 2.0))
f_open      = max(0.0, min(1.0, (f_canopy - 0.5) * 2.0))
f_seg2      = max(0.0, min(1.0, f_telescope * 2.0))
f_seg3      = max(0.0, min(1.0, (f_telescope - 0.5) * 2.0))

# Telescope section length (seg2 and seg3 share this length)
mast_open = float(mast_h)
SEG_L = max((mast_open - SEG1_L + 2.0 * SEG_OVERLAP) / 2.0, 30.0)

# HOOK_Z — the system's top. Drives seg3 and seg2 base/top positions
# in mast_geo. At fold=0: HOOK_Z=SEG1_L. At fold=0.5: HOOK_Z=mast top.
HOOK_Z_folded   = SEG1_L
HOOK_Z_deployed = SEG1_L + 2.0 * (SEG_L - SEG_OVERLAP)
HOOK_Z = HOOK_Z_folded + (HOOK_Z_deployed - HOOK_Z_folded) * f_telescope

# Human-readable phase label for QC panels
if f <= 0.01:   lbl = "CLOSED"
elif f < 0.5:   lbl = f"TELESCOPE {f_telescope:.0%}"
elif f < 0.99:  lbl = f"CANOPY {f_canopy:.0%}"
else:           lbl = "DEPLOYED"
phase_label = f"fold={f:.2f} [{lbl}] HOOK_Z={HOOK_Z:.0f}"
# ---------- end fold_phases ----------

# ---- group: PIP_CANOPY DEPLOY
# CANOPY DEPLOY
# Hub cylinder (rises during canopy phase)
# 4 radial spars from hub (open at fold>0.75)
# Top cloth canopy (nearly flat, V2)
# Horizontal storage rope rings (6 levels)
hub_geo = Script(hub_z=hub_z, f_rise=fold_phases.f_rise, SEG1_L=fold_phases.SEG1_L)  # -> out, hub, hub_z_a, hub_R
# ---------- hub_geo: Python ----------
#! python 3
# hub_geo — short cylinder that rises out of seg1 during canopy-rise phase.
# Spars attach radially from this hub.
import Rhino.Geometry as rg

HUB_R = 4.0   # hub radius (constant — passed downstream)
HUB_H = 3.0   # hub thickness

hub_folded_z = float(SEG1_L) * 0.5             # midpoint of seg1, hidden inside
hub_z_a = hub_folded_z + (float(hub_z) - hub_folded_z) * float(f_rise)

hub = [
    rg.Cylinder(
        rg.Circle(
            rg.Plane(rg.Point3d(0, 0, hub_z_a - HUB_H / 2.0), rg.Vector3d.ZAxis),
            HUB_R),
        HUB_H).ToBrep(True, True)
]
hub_R = HUB_R
# ---------- end hub_geo ----------
spars_geo = Script(
    spar_len=spar_len,
    spar_angle=spar_angle,
    spar_dia=spar_dia,
    f_open=fold_phases.f_open,
    hub_z_a=hub_geo.hub_z_a,
    hub_R=hub_geo.hub_R)  # -> out, spars, spar_tips, spar_len_a, spar_angle_a
# ---------- spars_geo: Python ----------
#! python 3
# spars_geo — 4 radial spars (pipes) sprouting from the hub at f_open.
# At f_open=0: spars are vertical stubs (angle=89°, length=0.5 — invisible).
# At f_open=1: angle=spar_angle slider, length=spar_len slider.
import Rhino.Geometry as rg
import math

AZIMUTHS = [0.0, math.pi/2.0, math.pi, 3.0*math.pi/2.0]

fo = float(f_open)
hz = float(hub_z_a)
hR = float(hub_R)

spar_angle_a = 89.0 + (float(spar_angle) - 89.0) * fo
spar_len_a   = 0.5  + (float(spar_len)   - 0.5)  * fo
ang_rad = math.radians(spar_angle_a)
cos_a = math.cos(ang_rad); sin_a = math.sin(ang_rad)
spar_R = float(spar_dia) / 2.0

def spar_pt(az, frac):
    r = hR + frac * spar_len_a * cos_a
    zp = hz + frac * spar_len_a * sin_a
    r = max(r, hR)
    return rg.Point3d(r * math.cos(az), r * math.sin(az), zp)

spars = []
spar_tips = []
for az in AZIMUTHS:
    p0 = spar_pt(az, 0.0)
    p1 = spar_pt(az, 1.0)
    spar_tips.append(p1)
    line = rg.LineCurve(p0, p1)
    pipes = rg.Brep.CreatePipe(line, spar_R, False, rg.PipeCapMode.Flat, True, 0.001, 0.01)
    if pipes:
        spars.extend(pipes)
# ---------- end spars_geo ----------
rings_storage = Script(
    ring_count=ring_count,
    rope_dia=rope_dia,
    hub_z_a=hub_geo.hub_z_a,
    hub_R=hub_geo.hub_R,
    spar_len_a=spars_geo.spar_len_a,
    spar_angle_a=spars_geo.spar_angle_a)  # -> out, rings
# ---------- rings_storage: Python ----------
#! python 3
# rings_storage — horizontal rope rings at multiple heights along the spars.
# Each ring is 4 pipe segments connecting consecutive (interpolated) spar points
# at a fixed fraction along the spar length.
import Rhino.Geometry as rg
import math

AZIMUTHS = [0.0, math.pi/2.0, math.pi, 3.0*math.pi/2.0]

n = max(1, int(ring_count))
rope_R = float(rope_dia) / 2.0
hz = float(hub_z_a)
hR = float(hub_R)
sla = float(spar_len_a)
saa = float(spar_angle_a)
ang_rad = math.radians(saa)
cos_a = math.cos(ang_rad); sin_a = math.sin(ang_rad)

def spar_point(az, frac):
    r = hR + frac * sla * cos_a
    zp = hz + frac * sla * sin_a
    r = max(r, hR)
    return rg.Point3d(r * math.cos(az), r * math.sin(az), zp)

# Ring height fractions: bottom ring at 10% up the spar, top at 55%
fracs = [0.10 + 0.45 * (i / float(max(n - 1, 1))) for i in range(n)]

rings = []
for fr in fracs:
    pts = [spar_point(az, fr) for az in AZIMUTHS]
    for i in range(4):
        line = rg.LineCurve(pts[i], pts[(i+1) % 4])
        pipes = rg.Brep.CreatePipe(line, rope_R, False, rg.PipeCapMode.Flat, True, 0.001, 0.01)
        if pipes:
            rings.extend(pipes)
# ---------- end rings_storage ----------
panel_canopy = Script(
    panel_z=panel_z,
    panel_L=panel_l,
    panel_W=panel_w,
    f_rise=fold_phases.f_rise,
    f_open=fold_phases.f_open,
    SEG1_L=fold_phases.SEG1_L,
    hub_R=hub_geo.hub_R)  # -> out, panel, panel_corners
# ---------- panel_canopy: Python ----------
#! python 3
# panel_canopy — NEARLY-FLAT version (2026-05-27 v2):
#   The rigging ropes from the spire tip pull each corner taut.
#   Previous version had center_sag = 30% of panel_size — too bowl-like.
#   New ratios make the canopy almost planar with only a slight droop:
#     - center_sag  = 6%  (was 30%)
#     - edge_sag    = 2%  (was 10%)
#     - corner_pull = 5%  unchanged — rigging lifts corners
import Rhino.Geometry as rg
import math

pz = float(panel_z)
pL = float(panel_L)
pW = float(panel_W)
fr = float(f_rise)
fo = float(f_open)
L1 = float(SEG1_L)
hR = float(hub_R)

# panel_z_a — rises from inside seg1 during canopy-rise phase
panel_folded_z = L1 * 0.45
panel_z_a = panel_folded_z + (pz - panel_folded_z) * fr

# Nearly-flat sag parameters
panel_size = max(pL, pW)
center_sag  = panel_size * 0.06
edge_sag    = panel_size * 0.02
corner_pull = panel_size * 0.05

r_closed = hR + 0.8
z_gathered = panel_z_a + panel_size / 4.0

corner_specs = [(pL/2.0, 0.0),
                (pW/2.0, math.pi/2.0),
                (pL/2.0, math.pi),
                (pW/2.0, 3.0*math.pi/2.0)]

def lerp_pt(a, b, t):
    return rg.Point3d(a.X + (b.X-a.X)*t, a.Y + (b.Y-a.Y)*t, a.Z + (b.Z-a.Z)*t)

corners = []
for r_open, az in corner_specs:
    c_closed = rg.Point3d(r_closed*math.cos(az), r_closed*math.sin(az), z_gathered)
    c_open   = rg.Point3d(r_open *math.cos(az), r_open *math.sin(az), panel_z_a + corner_pull)
    corners.append(lerp_pt(c_closed, c_open, fo))

edge_mids = []
for i in range(4):
    c1 = corners[i]; c2 = corners[(i+1) % 4]
    mid_z = z_gathered + (panel_z_a - edge_sag - z_gathered) * fo
    edge_mids.append(rg.Point3d((c1.X+c2.X)/2.0, (c1.Y+c2.Y)/2.0, mid_z))

center_z = z_gathered + (panel_z_a - center_sag - z_gathered) * fo
center_pt = rg.Point3d(0.0, 0.0, center_z)

m = rg.Mesh()
m.Vertices.Add(center_pt)
for c in corners:  m.Vertices.Add(c)
for e in edge_mids: m.Vertices.Add(e)
for i in range(4):
    m.Faces.AddFace(0, 1 + i, 5 + i)
    m.Faces.AddFace(0, 5 + i, 1 + ((i+1) % 4))
m.Normals.ComputeNormals()
m.Compact()

panel = [m]
panel_corners = corners
# ---------- end panel_canopy ----------

# ---- group: PIP_MAST + HOOK
# MAST + HOOK
# 3 telescoping segments + ground socket
# Spire stub + 4 curl arcs (rigging anchor)
hook_geo = Script(HOOK_Z=fold_phases.HOOK_Z)  # -> out, hook, spire_tip
# ---------- hook_geo: Python ----------
#! python 3
# hook_geo — spire stub + riser pipe + 4 hook curl arcs, all anchored at HOOK_Z.
# spire_tip is the attachment point for rigging ropes.
import Rhino.Geometry as rg
import math

SPIRE_H = 3.0      # short stub on top of seg3
HOOK_RISE = 5.0    # vertical riser between spire and curl arcs
HOOK_CURL_R = 5.0  # curl arc radius
PIPE_R = 0.6
SPIRE_R = 0.6

hz = float(HOOK_Z)

def pipe_from_curve(crv, r):
    pipes = rg.Brep.CreatePipe(crv, r, False, rg.PipeCapMode.Flat, True, 0.001, 0.01)
    return list(pipes) if pipes else []

hook = []

# Spire stub on top of seg3
hook.append(
    rg.Cylinder(rg.Circle(rg.Plane(rg.Point3d(0, 0, hz), rg.Vector3d.ZAxis), SPIRE_R),
                SPIRE_H).ToBrep(True, True)
)
spire_tip = rg.Point3d(0, 0, hz + SPIRE_H)

# Riser pipe from spire tip up by HOOK_RISE
base_z = hz + SPIRE_H
riser = rg.LineCurve(rg.Point3d(0, 0, base_z), rg.Point3d(0, 0, base_z + HOOK_RISE))
hook.extend(pipe_from_curve(riser, PIPE_R))

# Four hook curl arcs at +X, +Y, -X, -Y
p_top = rg.Point3d(0, 0, base_z + HOOK_RISE)
for az in [0.0, math.pi/2.0, math.pi, 3.0*math.pi/2.0]:
    dx = math.cos(az); dy = math.sin(az)
    p_mid = rg.Point3d(HOOK_CURL_R*dx, HOOK_CURL_R*dy, base_z + HOOK_RISE + HOOK_CURL_R)
    p_end = rg.Point3d(2*HOOK_CURL_R*dx, 2*HOOK_CURL_R*dy, base_z + HOOK_RISE)
    arc = rg.ArcCurve(rg.Arc(p_top, p_mid, p_end))
    hook.extend(pipe_from_curve(arc, PIPE_R))
# ---------- end hook_geo ----------
mast_geo = Script(
    socket_h=socket_h,
    HOOK_Z=fold_phases.HOOK_Z,
    SEG1_L=fold_phases.SEG1_L,
    SEG_L=fold_phases.SEG_L,
    SEG_OVERLAP=fold_phases.SEG_OVERLAP)  # -> out, mast, socket
# ---------- mast_geo: Python ----------
#! python 3
# mast_geo — telescoping mast (3 segments) + ground socket.
# Hook-leads-telescope: HOOK_Z drives seg3 top, which drives seg2 top.
# seg1 is fixed at z=0..SEG1_L (base segment, holds everything else folded).
import Rhino.Geometry as rg

SEG1_R = 5.0
SEG2_R = 2.0
SEG3_R = 1.0
SOCKET_R = 4.5

L1 = float(SEG1_L)
L_other = float(SEG_L)
overlap = float(SEG_OVERLAP)
hook = float(HOOK_Z)
sh = float(socket_h)

# seg3 hangs below hook, clamped so its base never goes below ground
seg3_top  = hook
seg3_base = max(0.0, hook - L_other)

# seg2 sits below seg3 with overlap; stays nested in seg1 until seg3 has climbed
seg2_top  = max(L1, seg3_base + overlap)
seg2_base = max(0.0, seg2_top - L_other)

def cyl(z_base, length, radius):
    return rg.Cylinder(
        rg.Circle(rg.Plane(rg.Point3d(0, 0, z_base), rg.Vector3d.ZAxis), radius),
        length).ToBrep(True, True)

mast = [
    cyl(0.0,       L1,                       SEG1_R),
    cyl(seg2_base, seg2_top - seg2_base,     SEG2_R),
    cyl(seg3_base, seg3_top - seg3_base,     SEG3_R),
]
socket = [cyl(-sh, sh, SOCKET_R)]
# ---------- end mast_geo ----------

# ---- group: PIP_CLOTH
# CLOTH
# Bottom seat catenary mesh (taut, V2)
fabric_hammock = Script(spar_tips=spars_geo.spar_tips)  # -> out, fabric; inputs spar_tips: list
# ---------- fabric_hammock: Python ----------
#! python 3
# fabric_hammock - TAUT V2.1 (2026-05-28 tweak):
#   - edge midpoints AT spar tip plane (z = tip_z) -> meets rigging
#   - center SAG = 13% of tip_r (was 10%) -- slightly more visible droop
import Rhino.Geometry as rg
import scriptcontext as sc
from System import Guid

def to_pt(p):
    if isinstance(p, rg.Point3d): return p
    if hasattr(p, 'Value') and isinstance(p.Value, rg.Point3d): return p.Value
    if isinstance(p, Guid):
        obj = sc.doc.Objects.Find(p)
        if obj is not None and isinstance(obj.Geometry, rg.Point):
            return obj.Geometry.Location
    if hasattr(p, 'X') and hasattr(p, 'Y') and hasattr(p, 'Z'):
        return rg.Point3d(float(p.X), float(p.Y), float(p.Z))
    raise TypeError(f"Cannot convert {type(p).__name__} to Point3d")

tips = [to_pt(p) for p in spar_tips]
tip_z = tips[0].Z
tip_r = abs(tips[0].X)

SAG = max(tip_r * 0.13, 4.0)
center = rg.Point3d(0.0, 0.0, tip_z - SAG)

# Edge midpoints AT the spar-tip plane - still meets the rigging
edge_mids = []
for i in range(4):
    t1 = tips[i]; t2 = tips[(i+1) % 4]
    edge_mids.append(rg.Point3d(
        (t1.X + t2.X) / 2.0,
        (t1.Y + t2.Y) / 2.0,
        tip_z))

m = rg.Mesh()
m.Vertices.Add(center)
for tp in tips:      m.Vertices.Add(tp)
for ep in edge_mids: m.Vertices.Add(ep)
for i in range(4):
    m.Faces.AddFace(0, 1 + i, 5 + i)
    m.Faces.AddFace(0, 5 + i, 1 + ((i + 1) % 4))
m.Normals.ComputeNormals()
m.Compact()
fabric = [m]
# ---------- end fabric_hammock ----------

# ---- group: PIP_RIGGING + STRAP
# RIGGING + STRAP
# Spire -> 12 attachment ropes
# NE diagonal elastic shoulder strap
strap_carry = Script(f_telescope=fold_phases.f_telescope, SEG1_L=fold_phases.SEG1_L, SEG1_R=fold_phases.SEG1_R)  # -> out, strap
# ---------- strap_carry: Python ----------
#! python 3
# strap_carry — diagonal NE shoulder strap (sits between ±X/±Y spars).
# Elastic: bulge factor lerps from 1.0 (loose loop at fold=0) to 0.06
# (retracted flat against body at fold=0.5+).
import Rhino.Geometry as rg

STRAP_R = 0.5
ft = float(f_telescope)
L1 = float(SEG1_L)
R1 = float(SEG1_R)

# NE diagonal anchor offset from mast axis (0.707 = cos(45°))
dx = R1 * 0.707
dy = R1 * 0.707

# Elastic bulge factor — loop collapses to body during telescope phase
bf = 1.0 + (0.06 - 1.0) * ft

pts = [
    rg.Point3d(dx,             dy,             L1 * 0.92),
    rg.Point3d(dx + 7.0  * bf, dy + 7.0  * bf, L1 + 14.0 * bf),
    rg.Point3d(dx + 13.0 * bf, dy + 13.0 * bf, L1 * 0.55),
    rg.Point3d(dx + 7.0  * bf, dy + 7.0  * bf, L1 * 0.10),
    rg.Point3d(dx,             dy,             L1 * 0.08),
]
crv = rg.Curve.CreateInterpolatedCurve(pts, 3)
pipes = rg.Brep.CreatePipe(crv, STRAP_R, False, rg.PipeCapMode.Round, True, 0.001, 0.01)
strap = list(pipes) if pipes else []
# ---------- end strap_carry ----------
rigging_ropes = Script(
    spire_tip=hook_geo.spire_tip,
    panel_corners=panel_canopy.panel_corners,
    spar_tips=spars_geo.spar_tips,
    f_canopy=fold_phases.f_canopy,
    rope_dia=rope_dia)  # -> out, rigging; inputs panel_corners: list, spar_tips: list
# ---------- rigging_ropes: Python ----------
#! python 3
# rigging_ropes — pipes from spire_tip to all canopy attachment points:
#   - 4 panel corners
#   - 4 spar tips
#   - 4 edge midpoints between consecutive spar tips
# Only generated when f_canopy > 0.001 (no ropes during pure telescope phase).
import Rhino.Geometry as rg
import scriptcontext as sc
from System import Guid

def to_pt(p):
    if isinstance(p, rg.Point3d):
        return p
    if hasattr(p, 'Value') and isinstance(p.Value, rg.Point3d):
        return p.Value
    if isinstance(p, Guid):
        obj = sc.doc.Objects.Find(p)
        if obj is not None and isinstance(obj.Geometry, rg.Point):
            return obj.Geometry.Location
    if hasattr(p, 'X') and hasattr(p, 'Y') and hasattr(p, 'Z'):
        return rg.Point3d(float(p.X), float(p.Y), float(p.Z))
    raise TypeError(f"Cannot convert {type(p).__name__} to Point3d")

tip = to_pt(spire_tip)
corners = [to_pt(p) for p in panel_corners]
tips = [to_pt(p) for p in spar_tips]
fc = float(f_canopy)
rigging_R = max((float(rope_dia) / 2.0) * 0.8, 0.15)

rigging = []
if fc > 0.001:
    targets = list(corners) + list(tips)
    # Add edge midpoints between consecutive spar tips
    for i in range(4):
        a = tips[i]; b = tips[(i+1) % 4]
        targets.append(rg.Point3d((a.X+b.X)/2.0, (a.Y+b.Y)/2.0, (a.Z+b.Z)/2.0))
    for tgt in targets:
        line = rg.LineCurve(tip, tgt)
        pipes = rg.Brep.CreatePipe(line, rigging_R, False, rg.PipeCapMode.Flat, True, 0.001, 0.01)
        if pipes:
            rigging.extend(pipes)
# ---------- end rigging_ropes ----------

# ----
geo = Geometry(fabric_hammock.fabric)
